# Grasshopper definition RhinoInsideRevitScriptingDemo_1127_TokyoAEC.gh (Grasshopper 1.0.7)
# plug-ins: Rhino.Inside for Autodesk Revit

# ---- group: Find the Name in runtime
c_script = CSharpScript()  # -> out, A
# ---------- c_script: C# ----------
    A = Rhino.NodeInCode.Components.NodeInCodeFunctions.GetDynamicMemberNames();
# ---------- end c_script ----------
panel = Panel(c_script.A)

# ----
# Rebar
panel_2 = Panel("0,0,0")
pt = Point(panel_2)
pt_2 = Point("0,2000,0")
series = Series(Start=0, Step=1, Count=10)
ln = Line(StartPoint=pt, EndPoint=pt_2)
X = UnitX(Factor=series)
multiplication = Multiplication(A=X, B=Slider(88, range=1..3000))
move = Move(Geometry=ln, Motion=multiplication)  # -> Geometry, Transform
crv = Curve(move.Geometry)
bbox = BoundingBox(Content=flatten(move.Geometry), Plane=PlaneXY(0, 0, 0), UnionBox=True)  # -> Box, Box_2
brep = Brep(bbox.Box)
c_script_2 = CSharpScript(crv=crv)  # -> out, simplify(A); inputs crv: Curve
# ---------- c_script_2: C# ----------
    Plane pln;
    crv.TryGetPlane(out pln);
    A = pln.Normal;
# ---------- end c_script_2 ----------
explode = Explode(Curve=crv, Recursive=True)  # -> simplify(Segments), Vertices
brpdshape = AddBrepDirectShape(Brep=brep, TrackingMode=2)
panel_3 = Panel("true")
c__revitapi = CSharpScript_RevitAPI(
    HostElement=brpdshape,
    Trigger=Button(),
    crvs=explode.Segments,
    norm=c_script_2.A,
    Reference=["C:\Program Files\Autodesk\Revit 2021\RevitAPI.dll", "C:\Program Files\Autodesk\Revit 2021\RevitAPIUI.dll", "C:\ProgramData\Autodesk\Revit\Addins\2021\RhinoInside.Revit\RhinoInside.Revit.dll"])  # -> out, rebar_result; inputs Trigger: Boolean, crvs: list of Curve, norm: Vector3d
# ---------- c__revitapi: C# usings ----------
using DB = Autodesk.Revit.DB;
using UI = Autodesk.Revit.UI;

using Autodesk.Revit.DB.Structure;

using RhinoInside.Revit;
using RhinoInside.Revit.Convert.Geometry;

using System.Linq;
# ---------- c__revitapi: C# ----------
    if(Trigger == false) return;

    host = HostElement as DB.Element;

    using(var txx = new DB.Transaction(Revit.ActiveDBDocument, Component.NickName))
    {
      txx.Start();
      var rebar = CreateRebar(Revit.ActiveDBDocument, host, crvs, norm.ToXYZ());
      // delete the hook

      var invId = DB.ElementId.InvalidElementId;
      rebar.SetHookTypeId(0, invId);
      rebar.SetHookTypeId(1, invId);

      // output
      rebar_result = rebar;
      txx.Commit();
    }
# ---------- c__revitapi: C# additional code ----------
  DB.Element host;
  private DB.Structure.Rebar CreateRebar(DB.Document doc, DB.Element hostElement, List<Curve> crvs, DB.XYZ normal){
    // Create the line rebar
    IList<DB.Curve> curves = crvs.Select(crv => crv.ToCurve()).ToList();
    // creating input parameters
    var barType = DB.Structure.RebarBarType.Create(Revit.ActiveDBDocument);

    var hookType = DB.Structure.RebarHookType.Create(Revit.ActiveDBDocument, Math.PI, 90);
    var rebar = DB.Structure.Rebar.CreateFromCurves(Revit.ActiveDBDocument, Autodesk.Revit.DB.Structure.RebarStyle.Standard, barType, hookType, hookType, hostElement as DB.Element, normal, curves, DB.Structure.RebarHookOrientation.Right, DB.Structure.RebarHookOrientation.Left, true, true);
    // if the ActiveView is View3D
    if(doc.ActiveView as DB.View3D != null)
      rebar.SetSolidInView(doc.ActiveView as DB.View3D, true);
    return rebar;
  }
# ---------- end c__revitapi ----------

# ---- group: RhinoCommon
# RhinoCommon_Transaction
number_slider = Slider(145, range=0..1000)
c__revitapi_2 = CSharpScript_RevitAPI(
    Radius=number_slider,
    Reference=["C:\Program Files\Autodesk\Revit 2021\RevitAPI.dll", "C:\Program Files\Autodesk\Revit 2021\RevitAPIUI.dll", "C:\ProgramData\Autodesk\Revit\Addins\2021\RhinoInside.Revit\RhinoInside.Revit.dll"])  # -> out, Sphere; inputs Radius: Double
# ---------- c__revitapi_2: C# usings ----------
using DB = Autodesk.Revit.DB;
using UI = Autodesk.Revit.UI;

using RIR = RhinoInside.Revit;
using RhinoInside.Revit.Convert.Geometry;
# ---------- c__revitapi_2: C# ----------
    Sphere = new Sphere(Point3d.Origin, Radius);
# ---------- end c__revitapi_2 ----------

# ---- group: RIR_ComponentExample
brep_2 = Brep(<brep referenced from the Rhino model>)
materials = QueryMaterials(Name="Glass")
geodshape = AddGeometryDirectShape(Geometry=brep_2, Material=materials, TrackingMode=2)

# ---- group: GetACategory
c__revitapi_3 = CSharpScript_RevitAPI(Reference=["C:\Program Files\Autodesk\Revit 2021\RevitAPI.dll", "C:\Program Files\Autodesk\Revit 2021\RevitAPIUI.dll", "C:\ProgramData\Autodesk\Revit\Addins\2021\RhinoInside.Revit\RhinoInside.Revit.dll"])  # -> out, A
# ---------- c__revitapi_3: C# usings ----------
using DB = Autodesk.Revit.DB;
using UI = Autodesk.Revit.UI;

using RhinoInside.Revit;
using RhinoInside.Revit.Convert.Geometry;
# ---------- c__revitapi_3: C# ----------
    A = DB.Category.GetCategory(Revit.ActiveDBDocument,DB.BuiltInCategory.OST_Walls);
# ---------- end c__revitapi_3 ----------
panel_4 = Panel(c__revitapi_3.A)

# ---- group: Casting_NodeInCode
materials_2 = QueryMaterials(Name="Glass")
brep_3 = Brep(<brep referenced from the Rhino model>)
c__revitapi_4 = CSharpScript_RevitAPI(
    BREP=brep_3,
    GL_material=materials_2,
    Reference=["C:\Program Files\Autodesk\Revit 2021\RevitAPI.dll", "C:\Program Files\Autodesk\Revit 2021\RevitAPIUI.dll", "C:\ProgramData\Autodesk\Revit\Addins\2021\RhinoInside.Revit\RhinoInside.Revit.dll"])  # -> out, DS; inputs BREP: Brep
# ---------- c__revitapi_4: C# usings ----------
using DB = Autodesk.Revit.DB;
using UI = Autodesk.Revit.UI;

using RIR = RhinoInside.Revit;
using RhinoInside.Revit.Convert.Geometry;

using Rhino.NodeInCode;
# ---------- c__revitapi_4: C# ----------
    var glass_material = GL_material as DB.Material;

    // AddMaterial component to create a material
    var queryMaterials = Components.FindComponent("RhinoInside_QueryMaterials");
    // and AddGeometryDirectShape to create a DirectShape element in Revit
    var addGeomDirectshape = Components.FindComponent("RhinoInside_AddGeometryDirectShape");

    if (queryMaterials == null || addGeomDirectshape == null) {
      throw new Exception("One or more of the necessary components are not available as node-in-code");
    }
    

    if(BREP != null) {
      //var newMaterials = queryMaterials.Invoke("", "Glass", null);

      
        
      string[] warnings;
      
      object[] dsElements = addGeomDirectshape.Evaluate(
        new object[]{
        "Custom DS",
        GetCategory("Walls"),
        BREP,
        glass_material
        },
        false,
        out warnings
        );
      
      
      // assign the new DirectShape element to output
      DS = dsElements[0];
    }
# ---------- c__revitapi_4: C# additional code ----------
  public DB.Category GetCategory(string categoryName){
    var doc = RIR.Revit.ActiveDBDocument;
    foreach(DB.Category cat in doc.Settings.Categories) {
      if (cat.Name == categoryName)
        return cat;
    }
    return null;
  }
# ---------- end c__revitapi_4 ----------
panel_5 = Panel(c__revitapi_4.DS)

# ---- group: NodeInCode
brep_4 = Brep(<brep referenced from the Rhino model>)
c__revitapi_5 = CSharpScript_RevitAPI(
    BREP=brep_4,
    Reference=["C:\Program Files\Autodesk\Revit 2021\RevitAPI.dll", "C:\Program Files\Autodesk\Revit 2021\RevitAPIUI.dll", "C:\ProgramData\Autodesk\Revit\Addins\2021\RhinoInside.Revit\RhinoInside.Revit.dll"])  # -> out, DS; inputs BREP: Brep
# ---------- c__revitapi_5: C# ----------
    

    // AddMaterial component to create a material
    var queryMaterials = Components.FindComponent("RhinoInside_QueryMaterials");
    // and AddGeometryDirectShape to create a DirectShape element in Revit
    var addGeomDirectshape = Components.FindComponent("RhinoInside_AddGeometryDirectShape");

    if (queryMaterials == null || addGeomDirectshape == null) {
      throw new Exception("One or more of the necessary components are not available as node-in-code");
    }


    if(BREP != null) {
      string[] warns;
      
      object[] newMaterials = queryMaterials.Evaluate( 
        new object[]{
        "", 
        "Glass", 
        null},
        false,
        out warns);



      string[] warnings;

      object[] dsElements = addGeomDirectshape.Evaluate(
        new object[]{
        "Custom DS",
        GetCategory("Walls"),
        BREP,
        newMaterials[0]
        },
        false,
        out warnings
        );


      // assign the new DirectShape element to output
      DS = dsElements[0];
    }
# ---------- c__revitapi_5: C# additional code ----------
  public DB.Category GetCategory(string categoryName){
    var doc = RIR.Revit.ActiveDBDocument;
    foreach(DB.Category cat in doc.Settings.Categories) {
      if (cat.Name == categoryName)
        return cat;
    }
    return null;
  }
# ---------- end c__revitapi_5 ----------
panel_6 = Panel(c__revitapi_5.DS)

# ----
# NodeInCode_Material
button = Button()

# ---- group: Bake_transaction
c__revitapi_6 = CSharpScript_RevitAPI(
    Radius=Slider(288, range=0..1000),
    bake=button,
    Reference=["C:\Program Files\Autodesk\Revit 2021\RevitAPI.dll", "C:\Program Files\Autodesk\Revit 2021\RevitAPIUI.dll", "C:\ProgramData\Autodesk\Revit\Addins\2021\RhinoInside.Revit\RhinoInside.Revit.dll"])  # -> out, Sphere; inputs Radius: Double, bake: Boolean
# ---------- c__revitapi_6: C# usings ----------
using DB = Autodesk.Revit.DB;
using UI = Autodesk.Revit.UI;

using RhinoInside.Revit;
using RhinoInside.Revit.Convert.Geometry;
using Autodesk.Revit.DB.Structure;
# ---------- c__revitapi_6: C# ----------
    if(bake == false) return;

    var doc = Revit.ActiveDBDocument;
    using(var tx = new DB.Transaction(doc, Component.NickName))
    {
      tx.Start();
      Sphere = CreateSphere(doc, Radius);
      tx.Commit();
    }
# ---------- c__revitapi_6: C# additional code ----------
  private DB.DirectShape CreateSphere(DB.Document doc, double radius)
  {
    var sphere = new Rhino.Geometry.Sphere(Rhino.Geometry.Point3d.Origin, radius);
    var brep = sphere.ToBrep();

    var revitCategory = new DB.ElementId((int) DB.BuiltInCategory.OST_GenericModel);

    var ds = DB.DirectShape.CreateElement(doc, revitCategory);
    var shapeList = new List<DB.GeometryObject>() { brep.ToSolid() };
    ds.AppendShape(shapeList);
    return ds;
  }
# ---------- end c__revitapi_6 ----------

# ----
panel_7 = Panel(c__revitapi_6.out)
